# Grasshopper definition Ver1.ghx (Grasshopper 1.0.7)

number_slider = Slider(6, range=0..10)
crv = Curve(<curve referenced from the Rhino model>)
crv_2 = Curve(<curve referenced from the Rhino model>)
panel = Panel("""0
1""")
divide = DivideCurve(Curve=crv, Count=number_slider, Kinks=False)  # -> Points, Tangents, Parameters
divide_2 = DivideCurve(Curve=crv_2, Count=number_slider, Kinks=False)  # -> Points, Tangents, Parameters
dispatch = Dispatch(List=divide_2.Points, DispatchPattern=panel)  # -> ListA, ListB
dispatch_2 = Dispatch(List=divide.Points, DispatchPattern=panel)  # -> ListA, ListB
pt = Point(dispatch_2.ListA)
pt_2 = Point(dispatch.ListB)
weave = Weave(Pattern=panel, Stream0=pt_2, Stream1=pt, NullGaps=False)
ln = Line(StartPoint=divide.Points, EndPoint=divide_2.Points)
pline = PolyLine(Vertices=weave, Closed=False)
